# Grasshopper definition 树结构检测(试题).gh (Grasshopper 1.0.8)

# ----
# -----------------------------------------------------------
# 2.举例100个随机圆，进行以1.5mm距离内的中心点距分组，保持原有父路径衍生子路径作group，展示思路或电池
# -----------------------------------------------------------
# 3.上述得出的结果，我期望取出树路径尾号为0-6的数据，并且，把一级路径和二级路径进行互换重组
cir = Circle(
    Plane=Tree({0}: [PlaneXY(4.973371683, 1.107439772, 0), PlaneXY(0.2637202573, 0.1267603366, 0), PlaneXY(9.303761613, 0.2971064627, 0), PlaneXY(19.69008484, 0.01157754101, 0), PlaneXY(17.7113431, 0.5673490281, 0), PlaneXY(11.7142601, 0.07057659331, 0), PlaneXY(12.98570147, 1.267407067, 0), PlaneXY(6.562670714, 0.04913424144, 0), PlaneXY(10.50823913, 1.199617615, 0), PlaneXY(2.282967112, 0.2623894393, 0), PlaneXY(16.10191296, 0.5700600848, 0), PlaneXY(13.43129197, 0.0194551237, 0), PlaneXY(3.827983012, 0.8031761464, 0), PlaneXY(1.260469659, 0.429712618, 0), PlaneXY(11.88392917, 1.040173956, 0), PlaneXY(7.028581261, 0.9111312315, 0)], {1}: [PlaneXY(14.67619918, 1.501338799, 0), PlaneXY(18.96784603, 4.124965078, 0), PlaneXY(0.6270893294, 3.173822445, 0), PlaneXY(11.54086949, 2.632081203, 0), PlaneXY(8.66027472, 3.339018209, 0), PlaneXY(2.903355082, 1.887639035, 0)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], {2}: [PlaneXY(8.44692768, 6.064084892, 0), PlaneXY(0.005968278277, 6.371859501, 0), PlaneXY(13.21427596, 5.120448142, 0), PlaneXY(3.348004587, 4.503421483, 0), PlaneXY(2.781501637, 7.201686286, 0), PlaneXY(5.665466872, 6.378145738, 0)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], {3}: [PlaneXY(19.95782102, 8.75821514, 0), PlaneXY(3.492954962, 9.938639905, 0), PlaneXY(13.12880424, 9.375742073, 0), PlaneXY(16.02292388, 8.321533743, 0), PlaneXY(0.01300712117, 9.355666302, 0), PlaneXY(9.778442685, 8.567557162, 0)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]),
    Radius=0.5)
suirify = Suirify(cir)

item_1_results = Data(Tree({0;0}: [{Plane=PlaneXY(7.028581261, 0.9111312315, 0), Radius=0.5}, {Plane=PlaneXY(6.562670714, 0.04913424144, 0), Radius=0.5}], {0;1}: [{Plane=PlaneXY(11.88392917, 1.040173956, 0), Radius=0.5}, {Plane=PlaneXY(10.50823913, 1.199617615, 0), Radius=0.5}, {Plane=PlaneXY(12.98570147, 1.267407067, 0), Radius=0.5}, {Plane=PlaneXY(11.7142601, 0.07057659331, 0), Radius=0.5}, {Plane=PlaneXY(13.43129197, 0.0194551237, 0), Radius=0.5}], {0;2}: [{Plane=PlaneXY(1.260469659, 0.429712618, 0), Radius=0.5}, {Plane=PlaneXY(2.282967112, 0.2623894393, 0), Radius=0.5}, {Plane=PlaneXY(0.2637202573, 0.1267603366, 0), Radius=0.5}], {0;3}: [{Plane=PlaneXY(3.827983012, 0.8031761464, 0), Radius=0.5}, {Plane=PlaneXY(4.973371683, 1.107439772, 0), Radius=0.5}], {0;4}: [{Plane=PlaneXY(16.10191296, 0.5700600848, 0), Radius=0.5}], {0;5}: [{Plane=PlaneXY(17.7113431, 0.5673490281, 0), Radius=0.5}]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))
viewer = ParamViewer(item_1_results)
